# Grasshopper definition 0_start.gh (Grasshopper 1.0.7)

pipeline = GeometryPipeline(
    GroupByLayer=False,
    GroupByType=False,
    IncludeHidden=True,
    IncludeLocked=True,
    LayerFilter="Default",
    NameFilter="*",
    SublayerFiltering=True,
    TypeFilter=1)
python = GhPythonScript(x_num=Slider(10, range=0..10), y_num=Slider(10, range=0..10), spacing=Slider(1.2, range=0..10), attractor=pipeline)  # -> out, points, circles; inputs x_num: Int32, y_num: Int32, attractor: Point3d
# ---------- python: Python ----------
import Rhino.Geometry as rh

points = []
circles = []

print("hello world!")

for x in range(int(x_num)):
    for y in range(int(y_num)):
        
        point = rh.Point3d(x * spacing, y * spacing, 0.0)
        points.append(point)
        dist = point.DistanceTo(attractor)
        
        if dist <= 2:
            circle = rh.Circle(point, 0.5 / 2)
        elif dist <= 4:
            circle = rh.Circle(point, 1.0 / 2)
        else : 
            circle = rh.Circle(point, 2.0 / 2)
        
        circles.append(circle)
# ---------- end python ----------
panel = Panel(python.out)
