# Grasshopper definition class2.gh (Grasshopper 1.0.7)

num = Slider(10, range=0..10)
num_2 = Slider(10, range=0..10)
pipeline = GeometryPipeline(
    GroupByLayer=False,
    GroupByType=False,
    IncludeHidden=True,
    IncludeLocked=True,
    LayerFilter="Default",
    NameFilter="*",
    SublayerFiltering=True,
    TypeFilter=1073741848)
python = GhPythonScript(srf=pipeline, u_num=num, v_num=num_2)  # -> out, pts, polys; inputs srf: Surface, u_num: Int32, v_num: Int32
# ---------- python: Python ----------
__author__ = "Eunice"

import rhinoscriptsyntax as rs


import Rhino.Geometry as rh

#print srf

print rh.PlaneSurface.IsValid
print srf.IsValid

print srf.Domain(0)

d_1 = srf.Domain(0)

u_min = d_1.Min
u_max = d_1.Max

d_2 = srf.Domain(1)

print u_min, u_max

v_min = d_2.Min
v_max = d_2.Max


print v_min, v_max


print type(srf)

a = srf.PointAt(5,5)
pts = []

# increment
u_inc = u_max / (u_num - 1)
v_inc = v_max / (v_num - 1)



for u in range(u_num):
    
    pts.append([])
    
    for v in range(v_num):
        
        # make the point
        pt = srf.PointAt(u * u_inc, v * v_inc)
        
        inner_list = pts[-1]
        #inner_list = pts[u]
        
        # add the point to the list
        inner_list.append(pt)



#define polys
polys = []


for i, row in enumerate(pts[:-1]):
    for j, pt_1 in enumerate(row[:-1]):

        pt_2 = row[j+1]
        next_row = pts[i+1]
        pt_3 = next_row[j+1]
        pt_4 = next_row[j]

        poly = rh.PolylineCurve([pt_1, pt_2, pt_3, pt_4, pt_1])
        polys.append(poly)
# ---------- end python ----------
python_2 = GhPythonScript(x=python.pts)  # -> out, a
# ---------- python_2: Python ----------
a = x
# ---------- end python_2 ----------
geo = Geometry(python.polys)
points = PointList(Points=python_2.a, Size=Slider(0.255, range=0..1))
panel = Panel(python_2.out)
boundary = BoundarySurfaces(Edges=geo)
